# Dynamo graph AddSharedParameterToFamilyFile.dyn (Dynamo 1.2.2.373)

# group: Choose the directory with the Revit Family files
directory_path = Directory("C:\Users\daniel.welter\Desktop\FamiliesTest")
watch = Watch(directory_path)

# group: Select all Family files in the given directory
string = StringInput("*.rfa")
boolean = BoolSelector(true)
contentsAll = Custom[DanEDU.Directory.ContentsAll](directory=watch, searchString=string, deepSearch=boolean)  # Get the files in a directory or a directory and its subdirectories (use bool value for deepsearch). Does not include hidden or readonly files (and thereby system files). Use string for extension type or * for all filetypes!

# group: Open all input files
openDocumentFile = RevitElements.Application.OpenDocumentFile(contentsAll.filePath)

# group: Add one or more Shared Parameter to the input Family files given
watch_2 = Watch(openDocumentFile)
code_block = CodeBlock()
# ---------- code_block.designscript (18 lines) ----------
//SharedParameterNames to be added
//{
"3P_Anmerkung";
//"3P_Bauteil",
//"3P_Bauteilkategorie",
//"3P_BKP",
//"3P_eBKP-H",
//"3P_Hersteller",
//"3P_Material",
//"3P_NPK",
//"3P_Typ"
//};
//SharedParameterFileGroupName
"10: 3-Plan-Parameter";
//RFAGroupName or BuiltInParameterGroupName
"PG_TEXT";
//ExemplarParameter Ja/Nein
false;
# ----------------------------------------
addSharedParameter = Custom[DanEDU.FamilyDocument.AddSharedParameter](familyDocument=watch_2, parameterName=code_block.out0, groupName=code_block.out1, group=code_block.out2, instance=code_block.out3)  # Add shared parameter by name inside a family document. Please note that a default shared parameter file must be set in Revit
watch_3 = Watch(addSharedParameter.log)

# group: Close Revit Family File
watch_4 = Watch(addSharedParameter.document)
boolean_2 = BoolSelector(true)
closeDocument = RevitElements.Application.CloseDocument(watch_4, boolean_2)
watch_5 = Watch(closeDocument)
