# Dynamo graph WallThermalTransmittance.dyn (Dynamo 2.19.3.6394)
# packages: LIMlab 1.0.17

# group: All walls in project
categories = Categories("OST_Walls")
all_elements_of_category = ElementsOfCategory(Category=categories)

# group: Rooms bounded by input walls
elementRoomBounded = Custom[ElementRoomBounded](ElementList=all_elements_of_category)  # package LIMlab

# group: Filter walls by room's parameter (heated or not heated rooms)
code_block = CodeBlock { 0; }
string = StringInput("Heated room")
getParameterValueByName = Element.GetParameterValueByName(element=elementRoomBounded.RoomsBounded, parameterName=string)
check_contains_0_1 = Python(IN[0]=elementRoomBounded.BoundingElements, IN[1]=getParameterValueByName)  # CPython3
# ---------- check_contains_0_1.python (24 lines) ----------
#IMPORT
import sys
import clr
clr.AddReference('ProtoGeometry')
from Autodesk.DesignScript.Geometry import *

#INPUT
wall_list = IN[0]
param_list = IN[1]

#FUNCTION
def verifica_condizione(list_param,list_wall):
    risultati = []
    for index,sottolista in enumerate(list_param):
        if 0 in sottolista and 1 in sottolista:
            risultati.append(list_wall[index])
    return risultati

#MAIN
walls_verified = verifica_condizione(param_list,wall_list)
out = walls_verified

#OUTPUT
OUT = out
# ----------------------------------------

name = Element.Name(element=check_contains_0_1)

# group: IfcGUID
string_2 = StringInput("IfcGUID")
getParameterValueByName_2 = Element.GetParameterValueByName(element=check_contains_0_1, parameterName=string_2)

# group: Calculation of thermal transmittance
code_block_2 = CodeBlock { Rsi=0.04; Rse=0.13; }
totalthermaltransmittance_meters = Custom[TotalThermalTransmittance[meters]](Rsi=code_block_2.Rsi, Rse=code_block_2.Rse, ElementList=check_contains_0_1)  # package LIMlab

# group: OUTPUT
analysed_walls = Watch(check_contains_0_1)
walls_ifcguid = Watch(getParameterValueByName_2)
thermal_transmittance_u_w_m²_k = Watch(totalthermaltransmittance_meters)

list_create = List.Create(item0=name, item1=analysed_walls, item2=walls_ifcguid, item3=thermal_transmittance_u_w_m²_k)
transpose = List.Transpose(lists=list_create)
