# Dynamo graph Detail lines into solids.dyn (Dynamo 2.17.0.3472)

selected_elements = Python()  # CPython3; unwired: IN[0]
# ---------- selected_elements.python (41 lines) ----------
import clr

clr.AddReference('RevitAPI')
import Autodesk
from Autodesk.Revit.DB import *

clr.AddReference('RevitServices')
import RevitServices
from RevitServices.Persistence import DocumentManager

doc = DocumentManager.Instance.CurrentDBDocument
uiapp = DocumentManager.Instance.CurrentUIApplication
app = uiapp.Application
uidoc = uiapp.ActiveUIDocument

clr.AddReference('RevitNodes')
import Revit
clr.ImportExtensions(Revit.Elements)

ueWrapper = None
wrappers = clr.GetClrType(Revit.Elements.ElementWrapper).GetMethods()
for w in wrappers:
	if w.ToString().startswith("Revit.Elements.UnknownElement"):
		ueWrapper = w
		break
		
out = []
selectElemId = uidoc.Selection.GetElementIds()
selectElem = [doc.GetElement(xId) for xId in selectElemId]

for i in selectElem:
	try:
		check = Revit.Elements.ElementWrapper.Wrap(i, True)
	except: check = None

	if check is None:
		out.append(ueWrapper.Invoke(None, (i, False)))
	else:
		out.append(i) 

OUT = out
# ----------------------------------------
curve = DetailCurve.Curve(detailCurve=selected_elements)
startPoint = Curve.StartPoint(curve=curve)
code_block = CodeBlock { 10; }
endPoint = Curve.EndPoint(curve=curve)
byTwoPoints = Vector.ByTwoPoints(start=startPoint, end=endPoint)
byCenterPointRadiusNormal = Circle.ByCenterPointRadiusNormal(centerPoint=startPoint, radius=code_block, normal=byTwoPoints)
sweepAsSolid = Curve.SweepAsSolid(curve=byCenterPointRadiusNormal, path=curve)
byUnion = Solid.ByUnion(solids=sweepAsSolid)
byGeometry = ImportInstance.ByGeometry(geometry=byUnion)
